vi "channel_estimate_MIMO_student.gvi"   [LabVIEW NXG]
inputs:
  "Modulation Parameters In": T6 = {"Modulation Type"="QPSK", "Control Information\nfor Packet Header/Tail"={"Training Sequence 1 (derived)"=[], "Zero Pad Length"=0, "Training Sequence 2 (derived)"=[]}, "RX Oversample Factor"=20, "Synchronization Options"={"Synchronization Method"="Timing Estimation", "Fixed Offset"=0, "Symbol Timing Recovery Method"="Max Energy", "Frame Detection Method"="Sliding Correlator", "Correct Frequency Offset"=FALSE}, "Number of Data Symbols (Derived)"=250, "RX Sample Rate"=4000000, "Pulse Shaping Parameters"={"Modulation Type"="PSK", "Pulse Shaping Filter"="Raised Cosine", "Filter Parameter"=0.5, "Filter Length (Symbols)"=8}, "Channel Estimation/Equalization Parameters"={"Equalization Method"="Direct", "Channel Estimate Length"=4, "Equalizer Length"=4, "Equalizer Delay"=-1}}
  "Input Symbol Sequence 1": c128[]
  "Input Symbol Sequence 2": c128[]
  "error in (no error)": error
outputs:
  "Modulation Parameters Out": T6
  "Channel estimates": T7
  "Mean-Square Error": f64
  "error out": error
types:
  T1 = cluster{"Training Sequence 1 (derived)": c128[], "Zero Pad Length": i32, "Training Sequence 2 (derived)": c128[]}
  T2 = cluster{"Synchronization Method": string, "Fixed Offset": i32, "Symbol Timing Recovery Method": string, "Frame Detection Method": string, "Correct Frequency Offset": bool}
  T3 = enum{"none", "Raised Cosine", "Root Raised Cos", "Gaussian"}
  T4 = cluster{"Modulation Type": enum{"FSK", "PSK", "QAM", "MSK", "PAM", "ASK"}, "Pulse Shaping Filter": T3, "Filter Parameter": f64, "Filter Length (Symbols)": i32}
  T5 = cluster{"Equalization Method": string, "Channel Estimate Length": i32, "Equalizer Length": i32, "Equalizer Delay": i32}
  T6 = cluster{"Modulation Type": string, "Control Information\nfor Packet Header/Tail": T1, "RX Oversample Factor": i32, "Synchronization Options": T2, "Number of Data Symbols (Derived)": i32, "RX Sample Rate": f64, "Pulse Shaping Parameters": T4, "Channel Estimation/Equalization Parameters": T5}
  T7 = cluster{"Element 1": c128[], "Element 2": c128[], "Element 3": c128[], "Element 4": c128[]}
diagram:
  case ($"error in (no error)") {
    frame No Error {
      Property Node(instance in=$"Modulation Parameters In") -> ("Control Information\nfor Packet Header/Tail:Training Sequence 1 (derived)"=w1, "Channel Estimation/Equalization Parameters:Channel Estimate Length"=w2)
      # L+1
      Decrement(x=w2) -> w3
      Array Subset(array=w1, index0=0, length0=w3) -> w4
      # ligne
      Reverse 1D Array(array=w4) -> (reversed array=w5)
      # Nt
      # t
      Array Size(array=w1) -> (size(s)=w6)
      Subtract(x=w6, y=w3) -> w7
      # colonne
      Array Subset(array=w1, index0=w3, length0=w7) -> w8
      call "student_toeplitz.gvi"(Row=w5, Column=w8)
    }
    frame Error { }
  }
